# Grasshopper definition H-shape_autosave.gh (Grasshopper 1.0.7)
# plug-ins: Octopus

height = Slider(38, range=1..50)
xpos = Slider(13, range=-100..50)
ypos = Slider(37, range=-100..50)
xsize = Slider(37, range=1..50)
ysize = Slider(98, range=1..100)
angle = Slider(305, range=0..360)
middelwidth = Slider(26, range=1..50)
witdth = Slider(1, range=0..50)
panel = Panel("Height ")
addition = Addition(A=xpos, B=witdth, C=xsize)
construct_point = ConstructPoint(XCoordinate=xpos, YCoordinate=ypos, ZCoordinate=0)
construct_point_2 = ConstructPoint(XCoordinate=addition, YCoordinate=ypos, ZCoordinate=0)
division = Division(A=ysize, B="2")
addition_2 = Addition(A=xpos, B=xsize)
addition_3 = Addition(A=ypos, B=division)
rectangle = Rectangle(Plane=construct_point, XSize=xsize, YSize=ysize, Radius=0)  # -> Rectangle, Length
rectangle_2 = Rectangle(Plane=construct_point_2, XSize=xsize, YSize=ysize, Radius=0)  # -> Rectangle, Length
division_2 = Division(A=middelwidth, B="2")
subtraction = Subtraction(A=addition_3, B=division_2)
octopus = Octopus(OctopusData_gene=[middelwidth, xpos, ypos, xsize, ysize, witdth, angle], OctopusData_obj=[open_space, gross_floor_area])
construct_point_3 = ConstructPoint(XCoordinate=addition_2, YCoordinate=subtraction, ZCoordinate=0)
rectangle_3 = Rectangle(Plane=construct_point_3, XSize=witdth, YSize=middelwidth, Radius=0)  # -> Rectangle, Length
merge = Merge(Data1=rectangle_3.Rectangle, Data2=rectangle.Rectangle, Data3=rectangle_2.Rectangle)
region_union = RegionUnion(Curves=merge)
area = Area(Geometry=region_union)  # -> Area, Centroid
rotate = Rotate(Geometry=region_union, Angle=degrees(angle), Plane=area.Centroid)  # -> Geometry, Transform
curve = Curve(<curve referenced from the Rhino model>)
region_intersection = RegionIntersection(CurvesA=curve, CurvesB=rotate.Geometry)
fillet = Fillet(Curve=region_intersection, Radius=Slider(3, range=0..10))
unit_z = UnitZ(Factor=height)
surface = Surface(fillet)
area_2 = Area(Geometry=surface)  # -> Area, Centroid
extrude = Extrude(Base=surface, Direction=unit_z)
surface_2 = Surface(curve)
region_difference = RegionDifference(CurvesA=surface_2, CurvesB=surface)
mass_multiplication = MassMultiplication(Input=area_2.Area)  # -> Result, PartialResults
surface_3 = Surface(region_difference)
area_3 = Area(Geometry=surface_3)  # -> Area, Centroid
gross_floor_area = Number(mass_multiplication.Result)
panel_2 = Panel(gross_floor_area)
panel_3 = Panel("Gross Floor area")
mass_addition = MassAddition(Input=area_3.Area)  # -> Result, PartialResults
open_space = Number(mass_addition.Result)
panel_4 = Panel(open_space)
panel_5 = Panel("Open Space")
