# Grasshopper definition Magnetizing_FPG_Preview_test3.gh (Grasshopper 1.0.7)
# plug-ins: Magnetizing_FPG, Heteroptera, Octopus, Wallacei, Human

roominstance = RoomInstance()
roominstance_2 = RoomInstance()
roominstance_3 = RoomInstance()
roominstance_4 = RoomInstance()
roominstance_5 = RoomInstance()
roominstance_6 = RoomInstance()
roominstance_7 = RoomInstance()
roominstance_8 = RoomInstance()
crv = Curve(<curve referenced from the Rhino model>)

center = Center(Geometric=crv)  # -> Center, Dimension
wlc_number_slider = Slider(-2, range=-15..15)
wlc_number_slider_2 = Slider(-5, range=-15..15)
deconstruct = Deconstruct(Point=center.Center)  # -> XComponent, YComponent, ZComponent
addition = Addition(A=wlc_number_slider, B=deconstruct.XComponent)
addition_2 = Addition(A=deconstruct.YComponent, B=wlc_number_slider_2)
construct_point = ConstructPoint(XCoordinate=addition, YCoordinate=addition_2, ZCoordinate=deconstruct.ZComponent)

construct_point_2 = ConstructPoint(XCoordinate=1, YCoordinate=1, ZCoordinate=0)
construct_point_3 = ConstructPoint(XCoordinate=0, YCoordinate=0, ZCoordinate=0)
line = Line(StartPoint=construct_point_3, EndPoint=construct_point_2)
curve = Curve([<curve referenced from the Rhino model> x5000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])
number_slider = Slider(194, range=0..360)
replace_nulls = ReplaceNulls(Items=curve, Replacements=line)  # -> Items, Count
deconstruct_2 = Deconstruct(Point=center.Center)  # -> XComponent, YComponent, ZComponent
brep = Brep([<brep referenced from the Rhino model> x526])
curve_2 = Curve(replace_nulls.Items)
addition_3 = Addition(A=deconstruct_2.ZComponent, B=1)
construct_point_4 = ConstructPoint(XCoordinate=deconstruct_2.XComponent, YCoordinate=deconstruct_2.YComponent, ZCoordinate=addition_3)
line_2 = Line(StartPoint=center.Center, EndPoint=construct_point_4)
rotate_axis = RotateAxis(Geometry=brep, Angle=degrees(number_slider), Axis=line_2)  # -> Geometry, Transform

rotate_axis_2 = RotateAxis(Geometry=crv, Angle=degrees(number_slider), Axis=line_2)  # -> Geometry, Transform
rotate_axis_3 = RotateAxis(Geometry=curve_2, Angle=degrees(number_slider), Axis=line_2)  # -> Geometry, Transform
pt = Point(construct_point)
custom_preview = CustomPreview(
    Geometry=rotate_axis.Geometry,
    Material={diffuse=RGB(190, 190, 190), emission=RGB(0, 0, 0), shine=0, specular=RGB(255, 255, 255), transparency=0})
custom_preview_2 = CustomPreview(
    Geometry=rotate_axis_3.Geometry,
    Material={diffuse=RGB(190, 190, 190), emission=RGB(0, 0, 0), shine=0, specular=RGB(255, 255, 255), transparency=0})
curve_3 = Curve(rotate_axis_3.Geometry)

ghpython_script = GhPythonScript(x=rotate_axis_2.Geometry, y=pt)  # -> out, a, b
# ---------- ghpython_script: Python ----------
__author__ = "ander"
__version__ = "2022.05.12"

import rhinoscriptsyntax as rs

list = []
list.append(x)
list.append(y)
a = list
# ---------- end ghpython_script ----------
merge = Merge(Data1=ghpython_script.a)
event_gate = EventGate(Data=merge)  # -> Data, IsNew
number = Number(0)
number_2 = Number(1)
list_item = ListItem(List=event_gate.Data, Index=number, Wrap=True)
list_item_2 = ListItem(List=event_gate.Data, Index=number_2, Wrap=True)
houseinstance = HouseInstance(Boundary=list_item, EntrancePoint=list_item_2)
data = Data(houseinstance)
magnetr_hes = MagnetizingRooms_HeapES(HouseInstance=data, Iterations=Slider(20, range=20..10000), MaxAdjDistance=Slider(3, range=1..5), CellSizeM=2)  # -> Corridors, RoomBreps, RoomNames, Adjacencies, MissingAdjacences, Boundary, BoundaryOffset
brep_2 = Brep(magnetr_hes.RoomBreps)
panel = Panel(magnetr_hes.RoomNames)
ghpython_script_2 = GhPythonScript(x=brep_2, y=magnetr_hes.RoomNames)  # -> out, openLandscape, rest; inputs x: list, y: list
# ---------- ghpython_script_2: Python ----------
__author__ = "ander"
__version__ = "2022.04.26"

import rhinoscriptsyntax as rs

openLandscapes = []
rest = []
i = 0
for names in y:
    if(names == "&&HALL&&Hall"):
        openLandscapes.append(x[i])
        print("2")
    else:
        rest.append(x[i])
        print("1")
    i += 1
    
    
openLandscape = openLandscapes
rest = rest
# ---------- end ghpython_script_2 ----------

# ---- group: Display cluster
cluster = Cluster(
    brep_2=magnetr_hes.Corridors,
    brep=magnetr_hes.RoomBreps,
    txt_2=magnetr_hes.RoomNames,
    txt=magnetr_hes.Adjacencies,
    int=magnetr_hes.MissingAdjacences)

# ----
gene_pool_and_slider_shuffler = GenePoolAndSliderShuffler(BooleanButton=Toggle(False))
wlc_number_slider_3 = Slider(1, range=0..5)
wlc_number_slider_4 = Slider(1, range=0..2)

crv_2 = Curve(magnetr_hes.BoundaryOffset)
crv_3 = Curve(magnetr_hes.Boundary)

hb_building_programs = HBBuildingPrograms({"LargeOffice", "MediumOffice", "SmallOffice", "MidriseApartment", "HighriseApartment", "Retail", "StripMall", "PrimarySchool", "SecondarySchool", "SmallHotel", "LargeHotel", "Hospital", "Outpatient", "Laboratory", "Warehouse", "SuperMarket", "FullServiceRestaurant", "QuickServiceRestaurant", "Courthouse", "LargeDataCenterHighITE", "LargeDataCenterLowITE", "SmallDataCenterHighITE", "SmallDataCenterLowITE"}, selected="LargeOffice")
geometry = Geometry(magnetr_hes.Corridors)
geometry_2 = Geometry(ghpython_script_2.openLandscape)
number_slider_2 = Slider(4, range=0..10)
wlc_number_slider_5 = Slider(8, range=3..10)
merge_faces = MergeFaces(Brep=geometry)  # -> Breps, Before, After
# Converting to closed brep
subtraction = Subtraction(A=wlc_number_slider_5, B=wlc_number_slider_3)

geometry_3 = Geometry(ghpython_script_2.rest)
number_slider_3 = Slider(4, range=0..10)
merge_faces_2 = MergeFaces(Brep=geometry_3)  # -> Breps, Before, After
unit_z = UnitZ(Factor=number_slider_3)
extrude = Extrude(Base=merge_faces_2.Breps, Direction=unit_z)
series = Series(Start=Slider(0, range=0..100), Step=number_slider_3, Count=subtraction)
unit_z_2 = UnitZ(Factor=series)
move = Move(Geometry=graft(extrude), Motion=unit_z_2)  # -> Geometry, Transform

subtraction_2 = Subtraction(A=wlc_number_slider_5, B=wlc_number_slider_4)
merge_faces_3 = MergeFaces(Brep=geometry_2)  # -> Breps, Before, After
unit_z_3 = UnitZ(Factor=number_slider_3)
unit_z_4 = UnitZ(Factor=number_slider_2)
extrude_2 = Extrude(Base=merge_faces.Breps, Direction=unit_z_3)
extrude_3 = Extrude(Base=merge_faces_3.Breps, Direction=unit_z_4)
searchprog = HBSearchPrograms(bldg_prog=hb_building_programs)  # -> room_prog; plug-in component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
item_selector = ItemSelector(
    searchprog,
    {"2019::LargeOffice::Attic", "2019::LargeOffice::BreakRoom", "2019::LargeOffice::Classroom", "2019::LargeOffice::ClosedOffice", "2019::LargeOffice::Conference", "2019::LargeOffice::Corridor", "2019::LargeOffice::Dining", "2019::LargeOffice::Elec/MechRoom", "2019::LargeOffice::Elevator Lobby", "2019::LargeOffice::Elevator Machine Room", "2019::LargeOffice::Elevator Shaft", "2019::LargeOffice::IT_Room", "2019::LargeOffice::Lobby", "2019::LargeOffice::Main Electrical", "2019::LargeOffice::Main Mechanical", "2019::LargeOffice::OfficeLarge Data Center", "2019::LargeOffice::OfficeLarge Main Data Center", "2019::LargeOffice::OpenOffice", "2019::LargeOffice::PrintRoom", "2019::LargeOffice::Restroom", "2019::LargeOffice::Stair", "2019::LargeOffice::Storage", "2019::LargeOffice::Vending"}, selected="2019::LargeOffice::OpenOffice")
series_2 = Series(Start=Slider(0, range=0..100), Step=number_slider_2, Count=wlc_number_slider_5)
series_3 = Series(Start=Slider(0, range=0..100), Step=Slider(4, range=0..10), Count=subtraction_2)
unit_z_5 = UnitZ(Factor=series_2)
move_2 = Move(Geometry=graft(extrude_3), Motion=unit_z_5)  # -> Geometry, Transform
unit_z_6 = UnitZ(Factor=series_3)
move_3 = Move(Geometry=graft(extrude_2), Motion=unit_z_6)  # -> Geometry, Transform
wlc_number_slider_6 = Slider(0.3, range=0.2..1.2)
wlc_number_slider_7 = Slider(1.7, range=1.5..3.5)
wlc_number_slider_8 = Slider(0.3, range=0.2..1.5)

facparam = HBFacadeParameters(north=0, east=Toggle(True), south=0, west=Toggle(False))  # -> fac_par; plug-in component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

facparam_2 = HBFacadeParameters(north="0.5", east="1", south="0.5", west="1")  # -> fac_par; plug-in component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

facparam_3 = HBFacadeParameters(north="0", east="45", south="0", west="-45")  # -> fac_par; plug-in component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

number_slider_4 = Slider(1, range=0..1)
data_recorder = DataRecorder(flatten(wlc_number_slider_6), DataLimit=-10, RecordData=False)
data_recorder_2 = DataRecorder(flatten(wlc_number_slider), DataLimit=-10, RecordData=False)
data_recorder_3 = DataRecorder(flatten(wlc_number_slider_7), DataLimit=-10, RecordData=False)
data_recorder_4 = DataRecorder(flatten(number_slider), DataLimit=-10, RecordData=False)
data_recorder_5 = DataRecorder(flatten(wlc_number_slider_2), DataLimit=-10, RecordData=False)
data_recorder_6 = DataRecorder(flatten(wlc_number_slider_8), DataLimit=-10, RecordData=False)
point = Point(Point(-5.00170372, -39.96730359, 0))
octopus = Octopus(
    OctopusData_gene=[wlc_number_slider_2, wlc_number_slider, number_slider, number_slider_4, wlc_number_slider_6, wlc_number_slider_7, wlc_number_slider_8, wlc_number_slider_5],
    OctopusData_obj=[sun_2, energy_tot, _1_tot_area])
compass = LBCompass(center=point)  # -> compass; plug-in component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

all_rooms = Geometry([move_2.Geometry, move.Geometry, move_3.Geometry])

intsolid = HBIntersectSolids(solids=flatten(all_rooms), run=Toggle(True))  # -> int_solids; plug-in component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
brep_3 = Brep(all_rooms)
area = Area(Geometry=brep_3)  # -> flatten(Area), Centroid

roomsolid = HBRoomFromSolid(geo=flatten(intsolid), program=item_selector, conditioned=True)  # -> report, rooms; plug-in component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
solveadj = HBSolveAdjacency(rooms=flatten(roomsolid.rooms), run=Toggle(True))  # -> report, adj_rooms; plug-in component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
aperturesbyratio = HBAperturesByRatio(
    hb_objs=flatten(solveadj.adj_rooms),
    ratio=wlc_number_slider_6,
    win_height=wlc_number_slider_7,
    sill_height=wlc_number_slider_8,
    operable=Toggle(False))  # -> report, hb_objs; plug-in component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
louvershades = HBLouverShades(
    hb_objs=flatten(aperturesbyratio.hb_objs),
    depth=facparam_2,
    angle=facparam_3,
    vertical=Toggle(True),
    flip_start=facparam)  # -> report, hb_objs; disabled; plug-in component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
multiplier = HBSetMultiplier(rooms=aperturesbyratio.hb_objs, multiplier="4")  # -> report, rooms; plug-in component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
lab_rooms = Data(flatten(multiplier.rooms))

bordershades = HBExtrudedBorderShades(hb_objs=flatten(aperturesbyratio.hb_objs), depth=facparam_2)  # -> out, hb_objs; disabled; plug-in component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
vizall = HBVisualizeAll(hb_objs=flatten(lab_rooms))  # -> geo; plug-in component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
stream_filter = StreamFilter(Gate=number_slider_4, Stream0=bordershades.hb_objs, Stream1=louvershades.hb_objs)
brep_wireframe = BrepWireframe(Brep=vizall, Density=-5)

# ----
# Edit the HVAC
toggle = BooleanToggle(False)
idealair = HBIdealAir(rooms=flatten(lab_rooms), dcv=toggle, sensible_hr="0", latent_hr="0")  # -> report, rooms; plug-in component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

all_rooms_2 = Data(flatten(lab_rooms))

rectangle = Rectangle(Plane=PlaneXY(0, 0, 0), XSize=Domain(-1, 1), YSize=Domain(-2, 2), Radius=0)  # -> Rectangle, Length
box_rectangle = BoxRectangle(Rectangle=rectangle.Rectangle, Height=Domain(0, 10))
brep_4 = Brep(box_rectangle)
roomsolid_2 = HBRoomFromSolid(geo=flatten(brep_4), name=",", conditioned=True)  # -> out, rooms; plug-in component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
ghpython_script_3 = GhPythonScript(x=all_rooms_2)  # -> out, a; inputs x: list, y: list
# ---------- ghpython_script_3: Python ----------
__author__ = "ander"
__version__ = "2022.05.16"

import rhinoscriptsyntax as rs

if(any(item in y for item in x)):
    pass
else:
    a = x
# ---------- end ghpython_script_3 ----------
event_gate_2 = EventGate(Data=ghpython_script_3.a)  # -> Data, IsNew
data_2 = Data(flatten(event_gate_2.Data))
list_length = ListLength(List=data_2)
panel_2 = Panel(list_length)
insert_items = InsertItems(List=data_2, Item=roomsolid_2.rooms, Indices=flatten(panel_2), Wrap=True)
data_3 = Data(flatten(insert_items))

# ----
# Visualize Attributes
roomenergyattr = HBRoomEnergyAttributes({"Program": "properties.energy.program_type.display_name", "Construction Set": "properties.energy.construction_set.display_name", "Is Conditioned": "properties.energy.is_conditioned", "People per Area [ppl/m2]": "properties.energy.people.people_per_area", "Area per Person [m2/ppl]": "properties.energy.people.area_per_person", "Lighting per Area [W/m2]": "properties.energy.lighting.watts_per_area", "Electric Equipment per Area [W/m2]": "properties.energy.electric_equipment.watts_per_area", "Gas Equipment per Area [W/m2]": "properties.energy.gas_equipment.watts_per_area", "Infiltration per Exterior Area [m3/s-m2]": "properties.energy.infiltration.flow_per_exterior_area", "Ventilation per Person [m3/s-ppl]": "properties.energy.ventilation.flow_per_person"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}, selected="Gas Equipment per Area [W/m2]")
faceenergyattr = HBFaceEnergyAttributes({"Construction": "properties.energy.construction.display_name", "Materials": "properties.energy.construction.layers", "R-Value": "properties.energy.construction.r_value", "U-Value": "properties.energy.construction.u_value", "U-Factor": "properties.energy.construction.u_factor", "Solar Transmitance [Unshaded]": "properties.energy.construction.solar_transmittance", "Solar Reflectance [Outside]": "properties.energy.construction.outside_solar_reflectance", "Solar Reflectance [Inside]": "properties.energy.construction.inside_solar_reflectance"}, selected="Solar Reflectance [Inside]")
colorroomattr = HBColorRoomAttributes(rooms_model=flatten(all_rooms_2), attribute=roomenergyattr)  # -> mesh, legend, wire_frame, values, colors; plug-in component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

colorfaceattr = HBColorFaceAttributes(hb_objs=flatten(all_rooms_2), attribute=faceenergyattr)  # -> mesh, legend, wire_frame, values, colors; plug-in component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
vizbytype = HBVisualizeByType(hb_objs=idealair.rooms)  # -> walls, interior_walls, roofs, ceilings, exterior_floors, interior_floors, air_walls, apertures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; plug-in component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

# ----
# Create the Model
panel_3 = Panel("OfficeBuilding")
model = HBModel(rooms=flatten(idealair.rooms), name=panel_3)  # -> report, model; plug-in component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

custom_preview_3 = CustomPreview(
    Geometry=vizbytype.walls,
    Material={diffuse=RGB(221, 160, 221), emission=RGB(66, 48, 66), shine=0, specular=RGB(255, 255, 255), transparency=0})
custom_preview_4 = CustomPreview(
    Geometry=vizbytype.exterior_floors,
    Material={diffuse=RGB(221, 160, 221), emission=RGB(66, 48, 66), shine=0.5, specular=RGB(255, 255, 255), transparency=0})
custom_preview_5 = CustomPreview(
    Geometry=vizbytype.roofs,
    Material={diffuse=RGB(0, 0, 0), emission=RGB(0, 0, 0), shine=0.1807691455, specular=RGB(44, 29, 21), transparency=0})
custom_preview_6 = CustomPreview(
    Geometry=vizbytype.interior_walls,
    Material={diffuse=RGB(0, 0, 0), emission=RGB(0, 0, 0), shine=1, specular=RGB(255, 255, 255), transparency=1})
custom_preview_7 = CustomPreview(
    Geometry=vizbytype.interior_floors,
    Material={diffuse=RGB(0, 0, 0), emission=RGB(0, 0, 0), shine=1, specular=RGB(255, 255, 255), transparency=1})
custom_preview_8 = CustomPreview(
    Geometry=vizbytype.apertures,
    Material={diffuse=RGB(0, 0, 0), emission=RGB(0, 0, 0), shine=1, specular=RGB(255, 255, 255), transparency=1})
custom_preview_9 = CustomPreview(
    Geometry=vizbytype.outdoor_shades,
    Material={diffuse=RGB(0, 0, 0), emission=RGB(0, 0, 0), shine=0.85, specular=RGB(191, 190, 190), transparency=0})

mesh_colours = MeshColours(Mesh=vizbytype.roofs, Colours=ColourSwatch(SwatchColor=RGB(54, 54, 54)))
mesh_colours_2 = MeshColours(Mesh=vizbytype.apertures, Colours=ColourSwatch(SwatchColor=RGB(148, 195, 224)))
mesh_colours_3 = MeshColours(Mesh=vizbytype.walls, Colours=ColourSwatch(SwatchColor=RGB(234, 235, 204)))

data_recorder_7 = DataRecorder(flatten(data_3), DataLimit=-10, RecordData=False)

ghpython_script_4 = GhPythonScript(x=data_recorder_7)  # -> out, a; inputs x: list
# ---------- ghpython_script_4: Python ----------
__author__ = "ander"
__version__ = "2022.05.16"

import rhinoscriptsyntax as rs

""""
for i in x:
    for j in x:
        if(str(i) == str(j) and str(i) != 'Room: ,'):
            remove
"""
"""
seen = set()
seen_add = seen.add
a = [i for i in x if not (i in seen or seen_add(i)) ]
"""
res = []
for i in x:
    if i not in res or str(i) == 'Room: ,':
        res.append(i)
count =0
print(res)
for i in res:
    if(str(res[count - 1]) == 'Room: ,' and count != 0):
        res.pop(count)
    count += 1
print(res)
if(len(res) > 2):
    while(str(res[-2]) == 'Room: ,'):
        res.pop(-2)
        
a = res
# ---------- end ghpython_script_4 ----------
panel_4 = Panel(ghpython_script_4.a)
ghpython_script_5 = GhPythonScript(x=ghpython_script_4.a)  # -> out, a; inputs x: list
# ---------- ghpython_script_5: Python ----------
__author__ = "ander"
__version__ = "2022.05.16"

import rhinoscriptsyntax as rs
count = 0
for i in x:
    if(str(i) == 'Room: ,'):
        count += 1
a = count
# ---------- end ghpython_script_5 ----------

# ----
# OpenStudio Energy Simulation
# Simulation Parameters
toggle_2 = BooleanToggle(True)
simoutput = HBSimulationOutput(zone_energy_use=toggle_2, report_frequency="Monthly")  # -> report, sim_output; plug-in component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
simcontrol = HBSimulationControl()  # -> sim_control; plug-in component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
shadowcalc = HBShadowCalculation(solar_dist="FullExterior")  # -> shadow_calc; plug-in component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
analysisperiod = LBAnalysisPeriod(start_month="1", start_day="1", start_hour=0, end_month="12", end_day="31")  # -> period, hoys, dates; plug-in component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
customoutput = HBCustomSimulationOutput(base_sim_output=simoutput.sim_output, output_names="Zone Mean Air Temperature")  # -> report, sim_output; plug-in component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

# ----
# Sun Exposure
boolean_toggle = BooleanToggle(True)
analysisperiod_2 = Ladybug_AnalysisPeriod(
    fromMonth=Slider(9, range=1..12),
    fromDay=Slider(1, range=1..31),
    fromHour=Slider(1, range=1..24),
    toMonth=Slider(10, range=1..12),
    toDay=Slider(31, range=1..31),
    toHour=Slider(24, range=1..24))  # -> out, analysisPeriod; plug-in component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
ladybug = Ladybug_Ladybug()  # -> out; plug-in component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
panel_5 = Panel(ladybug)

model_2 = HBModel(rooms=flatten(idealair.rooms))  # -> out, model; plug-in component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
gridrooms = HBSensorGridFromRooms(rooms=idealair.rooms, grid_size="0.5")  # -> grid, points, mesh; plug-in component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
assigngridsviews = HBAssignGridsAndViews(model=model_2.model, grids=flatten(gridrooms.grid))  # -> model; plug-in component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
# sun comfort interior
getgridsviews = HBGetGridsAndViews(model=assigngridsviews)  # -> views, grids, points, meshes; plug-in component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
mesh_join = MeshJoin(Meshes=getgridsviews.meshes)

mesh = Mesh(vizbytype.interior_floors)
mesh_2 = Mesh(vizbytype.exterior_floors)
area_2 = Area(Geometry=[mesh_2, mesh])  # -> Area, Centroid
area_3 = Area(Geometry=vizbytype.walls)  # -> Area, Centroid
area_4 = Area(Geometry=vizbytype.interior_walls)  # -> Area, Centroid
area_5 = Area(Geometry=vizbytype.roofs)  # -> Area, Centroid
area_6 = Area(Geometry=vizbytype.outdoor_shades)  # -> Area, Centroid
area_7 = Area(Geometry=vizbytype.apertures)  # -> Area, Centroid
mass_addition = MassAddition(Input=area_2.Area)  # -> Result, PartialResults
mass_addition_2 = MassAddition(Input=area_3.Area)  # -> Result, PartialResults
mass_addition_3 = MassAddition(Input=area_4.Area)  # -> Result, PartialResults
mass_addition_4 = MassAddition(Input=area_5.Area)  # -> Result, PartialResults
mass_addition_5 = MassAddition(Input=area_6.Area)  # -> Result, PartialResults
mass_addition_6 = MassAddition(Input=area_7.Area)  # -> Result, PartialResults
# Calc Material Cost
ghpython_script_6 = GhPythonScript(
    floor=mass_addition.Result,
    walls=mass_addition_2.Result,
    roof=mass_addition_4.Result,
    shades=mass_addition_5.Result,
    apertures=mass_addition_6.Result,
    intWalls=mass_addition_3.Result)  # -> out, a, b; disabled
# ---------- ghpython_script_6: Python ----------
__author__ = "ander"
__version__ = "2022.05.10"

import rhinoscriptsyntax as rs



floorPrice = 10 * floor
wallPrice = 15 * walls
roofPrice = 10 * roof
shadePrice = 20 * shades
aperturePrice = 40 * apertures
intwallPrice = 5 * intWalls

a = int(floorPrice + wallPrice + roofPrice + shadePrice + aperturePrice + intwallPrice)

b = True
# ---------- end ghpython_script_6 ----------

one_over_x = OneOverX(Value=mass_addition.Result)
multiplication = Multiplication(A=one_over_x, B=100000)

_1_tot_area = Number(multiplication)

event_gate_3 = EventGate(Data=_1_tot_area)  # -> Data, IsNew
panel_6 = Panel(_1_tot_area)
panel_7 = Panel(mass_addition.Result)

data_recorder_8 = DataRecorder(_1_tot_area, DataLimit=-10, RecordData=False)

ghpython_script_7 = GhPythonScript(x=data_recorder_8, y=ghpython_script_5.a)  # -> out, a; inputs x: list
# ---------- ghpython_script_7: Python ----------
__author__ = "ander"
__version__ = "2022.05.16"

import rhinoscriptsyntax as rs

""""
for i in x:
    for j in x:
        if(str(i) == str(j) and str(i) != 'Room: ,'):
            remove
"""

seen = set()
seen_add = seen.add
list = [i for i in x if not (i in seen or seen_add(i))]
count = 1
while(len(list) > y):
    list.pop(count)
    count += 1
a = list
# ---------- end ghpython_script_7 ----------

panel_8 = Panel("https://energyplus-weather.s3.amazonaws.com/europe_wmo_region_6/NOR/NOR_Oslo.Fornebu.014880_IWEC/NOR_Oslo.Fornebu.014880_IWEC.zip")
downloadepw = LBDownloadWeather(weather_URL=panel_8)  # -> epw_file, stat_file, ddy_file; plug-in component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
# Fast simulation
boolean_toggle_2 = BooleanToggle(False)
syncghfile = LBSyncGrasshopperFile(sync=boolean_toggle_2)  # -> report; plug-in component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

sizingpar = HBSizingParameter(ddy_file=downloadepw.ddy_file)  # -> sizing; plug-in component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
simpar = HBSimulationParameter(
    north="10",
    output=customoutput.sim_output,
    run_period=analysisperiod.period,
    timestep="4",
    sim_control=simcontrol,
    shadow_calc=shadowcalc,
    sizing=sizingpar)  # -> sim_par; plug-in component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

toggle_3 = BooleanToggle(False)
file_path = FilePath("C:\Users\ander\Documents\RRG\NOR_Oslo.Fornebu.014880_IWEC.epw")
modeltoosm = HBModelToOSM(model=model.model, epw_file=file_path, sim_par=simpar, write=toggle_3, run=toggle_3)  # -> report, jsons, osw, osm, idf, sql, zsz, rdd, html; plug-in component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
syncghfile_2 = LBSyncGrasshopperFile(sync=Toggle(True))  # -> report; plug-in component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

wea = HBWeaFromEPW(epw_file=downloadepw.epw_file)  # -> wea; plug-in component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
annualdaylight = HBAnnualDaylight(model=assigngridsviews, wea=wea, run=Toggle(False))  # -> out, results, flatten(DA), cDA, UDI, UDI_low, UDI_up; plug-in component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
heatmap = LBSpatialHeatmap(values=annualdaylight.DA, mesh=mesh_join)  # -> mesh, legend, title, colors, legend_par; plug-in component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

# ----
# Import Results
panel_9 = Panel("Zone Mean Air Temperature")
customresult = HBReadCustomResult(sql=modeltoosm.sql, output_names=panel_9)  # -> results; plug-in component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
roomenergyresult = HBReadRoomEnergyResult(sql=modeltoosm.sql)  # -> cooling, heating, lighting, electric_equip, gas_equip, process, hot_water, fan_electric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; plug-in component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

# ----
# Visualize Results
panel_10 = Panel("Cooling")
legendpar = LBLegendParameters(max="350000", seg_count="9", num_decimals="0", text_height="1.5")  # -> leg_par; plug-in component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
massarithop = LBMassArithmeticOperation(data=flatten(roomenergyresult.cooling), type=panel_10)  # -> data; plug-in component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
massarithop_2 = LBMassArithmeticOperation(data=flatten(roomenergyresult.heating), type="Heating")  # -> data; plug-in component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
monthlychart = LBMonthlyChart(data=[massarithop, massarithop_2], base_pt="-200,0,0", stack=Toggle(True), legend_par=legendpar)  # -> report, data_mesh, data_lines, col_lines, legend, borders, labels, y_title, title; plug-in component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

xdata = LBDeconstructData(data=roomenergyresult.cooling)  # -> header, flatten(values); plug-in component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
xdata_2 = LBDeconstructData(data=roomenergyresult.heating)  # -> header, flatten(values); plug-in component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
xdata_3 = LBDeconstructData(data=roomenergyresult.lighting)  # -> header, flatten(values); plug-in component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
xdata_4 = LBDeconstructData(data=roomenergyresult.electric_equip)  # -> header, flatten(values); plug-in component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
mass_addition_7 = MassAddition(Input=xdata_2.values)  # -> Result, PartialResults
mass_addition_8 = MassAddition(Input=xdata.values)  # -> Result, PartialResults
mass_addition_9 = MassAddition(Input=xdata_3.values)  # -> Result, PartialResults
mass_addition_10 = MassAddition(Input=xdata_4.values)  # -> Result, PartialResults
addition_4 = Addition(A=mass_addition_8.Result, B=mass_addition_7.Result, C=mass_addition_9.Result, D=mass_addition_10.Result)
panel_11 = Panel(addition_4)
number_3 = Number(addition_4)

gencumulativeskymtx = Ladybug_GenCumulativeSkyMtx(epwFile=downloadepw.epw_file, skyDensity=0, useOldRes=True, runIt=boolean_toggle)  # -> out, cumulativeSkyMtx; plug-in component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
selectskymtx = Ladybug_selectSkyMtx(
    cumulativeSkyMtx=gencumulativeskymtx.cumulativeSkyMtx,
    analysisPeriod=analysisperiod_2.analysisPeriod,
    removeDiffuse=False,
    removeDirect=False)  # -> out, selectedSkyMtx; plug-in component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

data_recorder_9 = DataRecorder(flatten(sun), DataLimit=-10, RecordData=False)
ghpython_script_8 = GhPythonScript(x=data_recorder_9, y=ghpython_script_5.a)  # -> out, a; inputs x: list; same code as ghpython_script_7
data_recorder_10 = DataRecorder(replace_nulls_2.Items, DataLimit=-10, RecordData=False)
ghpython_script_9 = GhPythonScript(x=data_recorder_10, y=ghpython_script_5.a)  # -> out, a; inputs x: list; same code as ghpython_script_7

ghpython_script_10 = GhPythonScript(
    x=flatten(ghpython_script_7.a),
    y=flatten(ghpython_script_4.a),
    z_1=flatten(data_recorder_4),
    z_2=flatten(data_recorder_5),
    z_3=flatten(data_recorder_2),
    z_4=flatten(data_recorder),
    z_5=flatten(data_recorder_3),
    z_6=flatten(data_recorder_6),
    u=flatten(ghpython_script_9.a),
    v=flatten(ghpython_script_8.a),
    w=Toggle(True))  # -> out, a, flatten(b), c; inputs x: list, y: list, z_1: list, z_2: list, z_3: list, z_4: list, z_5: list, z_6: list, u: list, v: list
# ---------- ghpython_script_10: Python ----------
__author__ = "ander"
__version__ = "2022.05.13"

import rhinoscriptsyntax as rs
max_area = 0
max_sun = 0
min_energy = 0
min_1 = 1000000
max_2 = 0
max = 0
index = 0
count = 0
while(len(z_1) < len(x)):
    z_1.append(0)
    z_2.append(0)
    z_3.append(0)
    z_4.append(0)
    z_5.append(0)
    z_6.append(0)

"""
while len(x) > len(u):
    x.pop(len(x))
    
"""

#and int(v[count]) > int(max_2)

if(w):
    for i in u:
        if(int(i) < int(min_1)):
            index = count
            max_sun = v[index]
            min_energy = i
            min_1 = i
            area = x[index]
            c = [z_1[index], z_2[index], z_3[index],
            z_4[index], z_5[index], z_6[index]]
        count += 1
    count = 0
    commacount = 0
    startpoint = 0
    endpoint = 0
    possiblestart = 0
    bool = False
    secondcomma = False
    print(index)
    for i in y:
        if(str(i) == 'Room: ,'):
            print("here")
            if(commacount == index):
                bool = True
            if(not bool):
                possiblestart = count
            print(possiblestart)
            """
            if(bool):
                startpoint = possiblestart
                print("her er startpoint", startpoint)
                break
            """
            if(commacount == index):
                endpoint = count
                startpoint = possiblestart 
                print("her er startpoint", startpoint)
                print("her er endpoint", endpoint)
                bool = True
                break
            commacount += 1
        count += 1
            
            
    #final = y[54*2*index:((index*54*2)+54)]
    print(startpoint)
    print(endpoint)
    final = y[startpoint:endpoint]
    print("hey")
    a = final
    b = " energy: ", min_energy, " sun: ", max_sun, "area: ",  area
    print(b)
# ---------- end ghpython_script_10 ----------
data_4 = Data(flatten(ghpython_script_10.a))
colorfaceattr_2 = HBColorFaceAttributes(hb_objs=flatten(data_4), attribute=faceenergyattr)  # -> mesh, legend, wire_frame, values, colors; plug-in component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

vizbytype_2 = HBVisualizeByType(hb_objs=data_4)  # -> walls, interior_walls, roofs, ceilings, exterior_floors, interior_floors, air_walls, apertures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; plug-in component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
mesh_3 = Mesh(vizbytype_2.interior_floors)
mesh_4 = Mesh(vizbytype_2.exterior_floors)
mesh_5 = Mesh([vizbytype_2.walls, vizbytype_2.roofs, vizbytype_2.apertures])
area_8 = Area(Geometry=[mesh_4, mesh_3])  # -> Area, Centroid
panel_12 = Panel(ghpython_script_10.b)
panel_13 = Panel(ghpython_script_10.c)
mesh_colours_4 = MeshColours(Mesh=vizbytype_2.roofs, Colours=ColourSwatch(SwatchColor=RGB(54, 54, 54)))
mesh_colours_5 = MeshColours(Mesh=vizbytype_2.apertures, Colours=ColourSwatch(SwatchColor=RGB(148, 195, 224)))
mesh_colours_6 = MeshColours(Mesh=vizbytype_2.walls, Colours=ColourSwatch(SwatchColor=RGB(234, 235, 204)))
mass_addition_11 = MassAddition(Input=area_8.Area)  # -> Result, PartialResults

annualloads = HBAnnualLoads(rooms=data_4, epw_file=downloadepw.epw_file, run=Toggle(True))  # -> out, total_load, cooling, heating, lighting, equip, process, hot_water, balance; plug-in component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
mass_addition_12 = MassAddition(Input=annualloads.total_load)  # -> Result, PartialResults
energy_consumption = Number(mass_addition_12.Result)

mass_addition_13 = MassAddition(Input=mass_addition_11.Result)  # -> Result, PartialResults
division = Division(A=mass_addition_13.Result, B=Slider(1, range=0..10))
multiplication_2 = Multiplication(A=mass_addition_13.Result, B=energy_consumption)
occupants = Number(division)
energy_m_2 = Number(energy_consumption)
tot_energy = Number(multiplication_2)
ghpython_script_11 = GhPythonScript(x=tot_energy)  # -> out, a
# ---------- ghpython_script_11: Python ----------
__author__ = "ander"
__version__ = "2022.05.16"

import rhinoscriptsyntax as rs

if(int(x)<100000):
    a = None
else:
    a = x
# ---------- end ghpython_script_11 ----------
panel_14 = Panel(occupants)
panel_15 = Panel(energy_m_2)
replace_nulls_2 = ReplaceNulls(Items=energy_m_2, Replacements=Slider(1000000, range=0..1000000))  # -> Items, Count; disabled
# oppupants
# energy per m^2
energy_tot = Number(ghpython_script_11.a)

radiationanalysis = Ladybug_RadiationAnalysis(
    north=number_slider,
    geometry=flatten(mesh_5),
    gridSize=Slider(72, range=0..100),
    disFromBase=Slider(1, range=0..1),
    selectedSkyMtx=flatten(selectskymtx.selectedSkyMtx),
    runIt=Toggle(True))  # -> out, contextMesh, analysisMesh, testPts, testVec, port, radiationResult, radiationMesh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; plug-in component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

# ----
# Energy total
panel_16 = Panel(energy_tot)
sun = Number(radiationanalysis.totalRadiation)  # disabled
one_over_x_2 = OneOverX(Value=sun)
multiplication_3 = Multiplication(A=one_over_x_2, B=1000000)
sun_2 = Number(multiplication_3)

# ==== cluster Cluster
txt = ClusterInput()
txt_2 = ClusterInput()
brep = ClusterInput()
brep_2 = ClusterInput()
int = ClusterInput()
txt_3 = Text(txt)
txt_4 = Text(txt_2)
brep_3 = Brep(brep)
brep_4 = Brep(brep_2)
int_2 = Integer(int)
txt_5 = Text(txt_4)
trim = TextTrim(Text=txt_3, Start=True, End=True)
len = TextLength(Text=txt_5)
min = Minimum(A="8", B=len)
fragment = TextFragment(Text=txt_5, Start="0", Count=min)
tmatch = MatchText(Text=fragment, Pattern="&&HALL&&", Case=True)
long = LongestList(ListA=tmatch, ListB="0", ListC="8", PaddingMode=2)  # -> ListA, ListB, ListC
brep_5 = Brep(brep_4)
brep_6 = Brep(brep_3)

# ---- group: Connections display
split = TextSplit(Text=trim, Separators="-,")
trim_2 = TextTrim(Text=split, Start=True, End=True)  # -> simplify(Result)
lng = ListLength(List=trim_2)  # -> expr("x-1", Length)
cull_i = CullIndex(List=trim_2, Indices=lng, Wrap=False)
int_3 = Integer(split)
dispatch = Dispatch(List=int_3, DispatchPattern=[True, False])  # -> ListA, ListB
item = ListItem(List=brep_6, Index=expr("x", dispatch.ListA), Wrap=True)
item_2 = ListItem(List=brep_6, Index=expr("x", dispatch.ListB), Wrap=True)
center = Center(Geometrical=item)  # -> Center, Dimension
center_2 = Center(Geometrical=item_2)  # -> Center, Dimension
ln = Line(StartPoint=center.Center, EndPoint=center_2.Center)
previewlw = CustomPreviewLineweights(Geometry=ln, Shader=ColourSwatch(SwatchColor=RGB(43, 43, 43)), Thickness=Slider(0.051, range=0..1), Absolute=True)

# ----
p_n_c = PickNChoose(Pattern=tmatch, Stream0=long.ListB, Stream1=long.ListC)
fragment_2 = TextFragment(Text=txt_5, Start=p_n_c)
txt_6 = Text(fragment_2)

# ---- group: Missing Adj Dots display
equals = Equality(FirstNumber=int_2, SecondNumber=0)  # -> Equality, Inequality
cull = CullPattern(List=brep_6, CullPattern=equals.Inequality)
center_3 = Center(Geometrical=cull)  # -> Center, Dimension
cir = Circle(Plane=center_3.Center, Radius=0.45)
boundary = BoundarySurfaces(Edges=cir)
previewlw_2 = CustomPreviewLineweights(Geometry=boundary, Shader=ColourSwatch(SwatchColor=RGB(227, 0, 0)), Absolute=False)

# ---- group: Names & Centers display
bbox = BoundingBox(Content=brep_6, Plane=PlaneXY(0, 0, 0))  # -> Box, Box_2
box_corners = BoxCorners(Box=bbox.Box)  # -> CornerA, CornerB, CornerC, CornerD, CornerE, CornerF, CornerG, CornerH
center_4 = Center(Geometrical=brep_6)  # -> Center, Dimension
text = DefineText(Text=txt_6, Plane=box_corners.CornerA, Size="2", Font="IBM Plex Sans Condensed Medium")
previewlw_3 = CustomPreviewLineweights(Geometry=[center_4.Center, text], Shader=ColourSwatch(SwatchColor=RGB(0, 0, 0)), Absolute=False)

# ---- group: Corridors display
hsl = ColourHSL(Alpha=1, Hue=0, Saturation=0, Luminance=Slider(1, range=0..1))
previewmat = CustomPreviewMaterials(Geometry=brep_5, DiffuseColor=hsl)

# ---- group: House Edges DISPLAY
join = BrepJoin(Breps=flatten([brep_5, brep_6]))  # -> Breps, Closed
edges = BrepEdges(Brep=join.Breps)  # -> Naked, Interior, NonManifold
number_slider = Slider(0.104, range=0..4)
crv = Curve(edges.Naked)
join_2 = JoinCurves(Curves=crv, Preserve=False)
offset = Offset(Curve=flatten(join_2), Distance=expr("x/2", number_slider), Plane=PlaneXY(0, 0, 0), Corners=1)
previewlw_4 = CustomPreviewLineweights(Geometry=flatten(offset), Shader=ColourSwatch(SwatchColor=RGB(0, 0, 0)), Thickness=number_slider, Absolute=True)

# ---- group: Room colors display
lng_2 = ListLength(List=brep_6)
division = Division(A=".5", B=lng_2)
series = Series(Start=0, Step=division, Count=lng_2)
addition = Addition(A=series, B=Slider(0.108, range=0..1))
long_2 = LongestList(ListA=tmatch, ListB=Slider(0.637, range=0..1), ListC="1", PaddingMode=2)  # -> ListA, ListB, ListC

# ----
p_n_c_2 = PickNChoose(Pattern=tmatch, Stream0=long_2.ListB, Stream1=long_2.ListC)

# ---- group: Room colors display (continued)
hsl_2 = ColourHSL(Alpha=1, Hue=addition, Saturation=1, Luminance=p_n_c_2)
previewmat_2 = CustomPreviewMaterials(Geometry=brep_6, DiffuseColor=hsl_2)

# ---- group: Rooms Edges DISPLAY
crv_2 = Curve(simplify(brep_6))
subtraction = Subtraction(A=hsl_2, B=ColourSwatch(SwatchColor=RGB(71, 71, 71)))  # -> simplify(Result)
previewlw_5 = CustomPreviewLineweights(Geometry=crv_2, Shader=subtraction, Thickness=Slider(0.049, range=0..4), Absolute=True)
