# Grasshopper definition cshape2fin (4).gh (Grasshopper 1.0.7)
# plug-ins: Heteroptera, Octopus, Human

thickness = Slider(-18, range=-31..-1)
curve = Curve(<curve referenced from the Rhino model>)
offset_curve = OffsetCurve(Curve=curve, Distance="0", Corners=1)  # -> reparameterize(Curve)
offset_curve_2 = OffsetCurve(Curve=offset_curve, Distance=thickness, Corners=1)  # -> reparameterize(Curve)
precision = Slider(20, range=10..20)
merge = Merge(Data1=offset_curve, Data2=offset_curve_2)  # -> flatten(Result)
subtraction = Subtraction(A=precision, B="1")
divide_curve = DivideCurve(Curve=merge, Count=precision, Kinks=False)  # -> Points, Tangents, Parameters
# Creating and removing base curves
shatter = Shatter(Curve=graft(merge), Parameters=divide_curve.Parameters)
snake_length = Slider(8, range=1..10)
rotation = GenePool(Decimals=0, Maximum=19, Minimum=0, Value=0.4265373277)
pool_controller = PoolController(GenePool=rotation, Range=subtraction, Randomness=0.1)
ghpython_script = GhPythonScript(seg=shatter, pos=rotation, leng=snake_length)  # -> out, a; inputs seg: list, pos: Int32, leng: Int32
# ---------- ghpython_script: Python ----------
__author__ = "Hoyer"
__version__ = "2022.03.18"

import rhinoscriptsyntax as rs
print(len(seg))

if(leng == 0):
    a = seg
else:
    for i in range(leng):
        print("len " , len(seg))
        print("pos:", pos)
        if(pos >= len(seg)):
            seg.pop(0)
            
        else:
            seg.pop(pos)


a = seg
# ---------- end ghpython_script ----------
join_curves = JoinCurves(Curves=ghpython_script.a, Preserve=False)  # -> flatten(Curves)

end_points = EndPoints(Curve=join_curves)  # -> Start, End
list_item = ListItem(List=end_points.End, Index="1", Wrap=True)
list_item_2 = ListItem(List=end_points.End, Index="0", Wrap=True)
list_item_3 = ListItem(List=end_points.Start, Index="0", Wrap=True)
list_item_4 = ListItem(List=end_points.Start, Index="1", Wrap=True)
line = Line(StartPoint=list_item_3, EndPoint=list_item_4)
line_2 = Line(StartPoint=list_item_2, EndPoint=list_item)
# Connect curves
merge_2 = Merge(Data1=line, Data2=line_2, Data3=join_curves)
join_curves_2 = JoinCurves(Curves=merge_2, Preserve=False)

surface = Surface(join_curves_2)  # disabled
ghpython_script_2 = GhPythonScript(x=surface)  # -> out, a
# ---------- ghpython_script_2: Python ----------
__author__ = "Hoyer"
__version__ = "2022.05.16"

import rhinoscriptsyntax as rs

if(x == None):
    a = True
else:
    a = False
# ---------- end ghpython_script_2 ----------

number_slider = Slider(6, range=3..8)
# Extrusion
unit_z = UnitZ(Factor="4")
extrude = Extrude(Base=surface, Direction=unit_z)
series = Series(Start="0", Step="4", Count=number_slider)
unit_z_2 = UnitZ(Factor=series)
move = Move(Geometry=extrude, Motion=unit_z_2)  # -> Geometry, Transform

octopus = Octopus(
    OctopusData_gene=[thickness, rotation, snake_length, number_slider_4, number_slider_2, number_slider_3],
    OctopusData_obj=[_1_total_area, energy_consumption, _1_solar_radiation])  # disabled

area = Area(Geometry=surface)  # -> Area, Centroid
multiplication = Multiplication(A=area.Area, B=number_slider)
one_over_x = OneOverX(Value=multiplication)
multiplication_2 = Multiplication(A=one_over_x, B="100000")
# Calculate area
ghpython_script_3 = GhPythonScript(x=multiplication_2, y=ghpython_script_2.a)  # -> out, a
# ---------- ghpython_script_3: Python ----------
__author__ = "Hoyer"
__version__ = "2022.05.16"

import rhinoscriptsyntax as rs

if(y):
    a = 90000
else:
    a = x
# ---------- end ghpython_script_3 ----------
_1_total_area = Number(ghpython_script_3.a)

hb_building_programs = HBBuildingPrograms({"LargeOffice", "MediumOffice", "SmallOffice", "MidriseApartment", "HighriseApartment", "Retail", "StripMall", "PrimarySchool", "SecondarySchool", "SmallHotel", "LargeHotel", "Hospital", "Outpatient", "Laboratory", "Warehouse", "SuperMarket", "FullServiceRestaurant", "QuickServiceRestaurant", "Courthouse", "LargeDataCenterHighITE", "LargeDataCenterLowITE", "SmallDataCenterHighITE", "SmallDataCenterLowITE"}, selected="LargeOffice")
brep = Brep(move.Geometry)
intsolid = HBIntersectSolids(solids=flatten(brep), run=Toggle(True))  # -> int_solids; plug-in component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
searchprog = HBSearchPrograms(bldg_prog=hb_building_programs)  # -> room_prog; plug-in component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
item_selector = ItemSelector(
    searchprog,
    {"2013::LargeOffice::Attic", "2013::LargeOffice::BreakRoom", "2013::LargeOffice::Classroom", "2013::LargeOffice::ClosedOffice", "2013::LargeOffice::Conference", "2013::LargeOffice::Corridor", "2013::LargeOffice::Dining", "2013::LargeOffice::Elec/MechRoom", "2013::LargeOffice::IT_Room", "2013::LargeOffice::Lobby", "2013::LargeOffice::OfficeLarge Data Center", "2013::LargeOffice::OfficeLarge Main Data Center", "2013::LargeOffice::OpenOffice", "2013::LargeOffice::PrintRoom", "2013::LargeOffice::Restroom", "2013::LargeOffice::Stair", "2013::LargeOffice::Storage", "2013::LargeOffice::Vending"}, selected="2013::LargeOffice::OpenOffice")
roomsolid = HBRoomFromSolid(geo=flatten(intsolid), program=item_selector, conditioned=True)  # -> out, rooms; plug-in component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
number_slider_2 = Slider(0.4, range=0.2..1.5)
number_slider_3 = Slider(0.2, range=0.2..0.7)
number_slider_4 = Slider(1.6, range=1.5..3.5)
# Honeybee BIM elements
solveadj = HBSolveAdjacency(rooms=flatten(roomsolid.rooms), run=Toggle(True))  # -> out, adj_rooms; plug-in component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
aperturesbyratio = HBAperturesByRatio(hb_objs=flatten(solveadj.adj_rooms), ratio=number_slider_3, win_height=number_slider_4, sill_height=number_slider_2)  # -> out, hb_objs; plug-in component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

vizbytype = HBVisualizeByType(hb_objs=aperturesbyratio.hb_objs)  # -> walls, interior_walls, roofs, ceilings, exterior_floors, interior_floors, air_walls, apertures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; plug-in component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
# Visulize honebee components
custom_preview = CustomPreview(
    Geometry=vizbytype.walls,
    Material={diffuse=RGB(221, 160, 221), emission=RGB(66, 48, 66), shine=0.5, specular=RGB(255, 255, 255), transparency=0})
custom_preview_2 = CustomPreview(
    Geometry=vizbytype.roofs,
    Material={diffuse=RGB(221, 160, 221), emission=RGB(66, 48, 66), shine=0.5, specular=RGB(255, 255, 255), transparency=0})
custom_preview_3 = CustomPreview(
    Geometry=vizbytype.exterior_floors,
    Material={diffuse=RGB(221, 160, 221), emission=RGB(66, 48, 66), shine=0.5, specular=RGB(255, 255, 255), transparency=0})
custom_preview_4 = CustomPreview(
    Geometry=vizbytype.interior_floors,
    Material={diffuse=RGB(221, 160, 221), emission=RGB(66, 48, 66), shine=0.5, specular=RGB(255, 255, 255), transparency=0})
custom_preview_5 = CustomPreview(
    Geometry=vizbytype.apertures,
    Material={diffuse=RGB(221, 160, 221), emission=RGB(66, 48, 66), shine=0.5, specular=RGB(255, 255, 255), transparency=0})
custom_preview_6 = CustomPreview(
    Geometry=vizbytype.outdoor_shades,
    Material={diffuse=RGB(221, 160, 221), emission=RGB(66, 48, 66), shine=0.5, specular=RGB(255, 255, 255), transparency=0})
mesh_colours = MeshColours(Mesh=vizbytype.roofs, Colours=ColourSwatch(SwatchColor=RGB(54, 54, 54)))
mesh_colours_2 = MeshColours(Mesh=vizbytype.apertures, Colours=ColourSwatch(SwatchColor=RGB(148, 195, 224)))
mesh_colours_3 = MeshColours(Mesh=vizbytype.walls, Colours=ColourSwatch(SwatchColor=RGB(234, 235, 204)))

panel = Panel("https://energyplus-weather.s3.amazonaws.com/europe_wmo_region_6/NOR/NOR_Oslo.Fornebu.014880_IWEC/NOR_Oslo.Fornebu.014880_IWEC.zip")
downloadepw = LBDownloadWeather(weather_URL=panel)  # -> epw_file, stat_file, ddy_file; plug-in component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
annualloads = HBAnnualLoads(rooms=aperturesbyratio.hb_objs, epw_file=downloadepw.epw_file, run=Toggle(True))  # -> out, total_load, cooling, heating, lighting, equip, balance; plug-in component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
point = Point(<point referenced from the Rhino model>)
panel_2 = Panel(annualloads.total_load)
mass_addition = MassAddition(Input=annualloads.total_load)  # -> Result, PartialResults
# Calculate Energy consumption
compass = LBCompass(north=Slider(14, range=0..360), center=point, scale=Slider(1, range=1..3))  # -> compass; plug-in component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
energy_c = Number(mass_addition.Result)
number = Number(multiplication)
multiplication_3 = Multiplication(A=number, B=energy_c)
ghpython_script_4 = GhPythonScript(x=multiplication_3, y=ghpython_script_2.a)  # -> out, a
# ---------- ghpython_script_4: Python ----------
__author__ = "Hoyer"
__version__ = "2022.05.16"

import rhinoscriptsyntax as rs

if(y):
    a = 900000000
else:
    a = x
# ---------- end ghpython_script_4 ----------
energy_consumption = Number(ghpython_script_4.a)
panel_3 = Panel(energy_consumption)

# ----
# Sun Exposure
boolean_toggle = BooleanToggle(True)
gencumulativeskymtx = Ladybug_GenCumulativeSkyMtx(epwFile=downloadepw.epw_file, skyDensity=0, useOldRes=True, runIt=boolean_toggle)  # -> out, cumulativeSkyMtx; plug-in component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
analysisperiod = Ladybug_AnalysisPeriod(
    fromMonth=Slider(9, range=1..12),
    fromDay=Slider(1, range=1..31),
    fromHour=Slider(1, range=1..24),
    toMonth=Slider(10, range=1..12),
    toDay=Slider(31, range=1..31),
    toHour=Slider(24, range=1..24))  # -> out, analysisPeriod; plug-in component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
selectskymtx = Ladybug_selectSkyMtx(
    cumulativeSkyMtx=gencumulativeskymtx.cumulativeSkyMtx,
    analysisPeriod=analysisperiod.analysisPeriod,
    removeDiffuse=False,
    removeDirect=False)  # -> out, selectedSkyMtx; plug-in component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
ladybug = Ladybug_Ladybug()  # -> out; plug-in component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
panel_4 = Panel(ladybug)
radiationanalysis = Ladybug_RadiationAnalysis(
    geometry=flatten(brep),
    gridSize=Slider(72, range=0..100),
    disFromBase=Slider(1, range=0..1),
    selectedSkyMtx=flatten(selectskymtx.selectedSkyMtx),
    runIt=Toggle(True))  # -> out, contextMesh, analysisMesh, testPts, testVec, port, radiationResult, radiationMesh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; plug-in component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

solar_radiation = Number(radiationanalysis.totalRadiation)
panel_5 = Panel(solar_radiation)
one_over_x_2 = OneOverX(Value=solar_radiation)
multiplication_4 = Multiplication(A=one_over_x_2, B="100000")
ghpython_script_5 = GhPythonScript(x=multiplication_4, y=ghpython_script_2.a)  # -> out, a
# ---------- ghpython_script_5: Python ----------
__author__ = "Hoyer"
__version__ = "2022.05.16"

import rhinoscriptsyntax as rs

if(y):
    a = 100000
else:
    a = x
# ---------- end ghpython_script_5 ----------
_1_solar_radiation = Number(ghpython_script_5.a)
